# Grasshopper definition LinkAI_GH_Henrik_RH7.gh (Grasshopper 1.0.7)

# ---- group: Inputs
panel = Panel("You are a sentiment analysis expert, after the user inputs a sentence, please output mood and a score from 1-10, where 10 is positive, 1 is negative. Provide output as the following format: Mood: Score: Reason: ")
panel_2 = Panel("Today is a very sunny hump day")

# ----
# For available models, please check LinkAI API website:
# 
# https://docs.link-ai.tech/platform/api/chat
number_slider = Slider(0.1, range=0..1)
panel_3 = Panel("wenxin")
panel_4 = Panel("gemini-1.5-flash")
panel_5 = Panel("claude-3-haiku")
panel_6 = Panel("qwen-turbo")

python = GhPythonScript(
    API_KEY="Link_5BtepTCZke2H1qxuPACOgwf32rIR0v13P3YfJKVBWn",
    System_Message=panel,
    Prompt=panel_2,
    AI_Model="LinkAI-4o-mini",
    Randomness=number_slider,
    SEND=Toggle(False))  # -> out, a; inputs SEND: Boolean
# ---------- python: Python ----------
import urllib2
import json

model = AI_Model
temperature = Randomness


# 创建请求
url = 'https://api.link-ai.tech/v1/chat/completions'
headers = {
    'Content-Type': 'application/json',
    'Authorization': 'Bearer {}'.format(API_KEY)
}
payload = {
    "temperature": temperature,
    "model": model,
    "messages": [
        {
            "role": "system",
            "content": [
                {"type": "text", "text": System_Message}
            ]
        },
        {
            "role": "user",
            "content": [
                {"type": "text", "text": Prompt}
            ]
        }
    ],
    "max_tokens": 300
}

data = json.dumps(payload)

if SEND:
    try:
        req = urllib2.Request(url, data, headers)
        response = urllib2.urlopen(req)
        response_data = response.read()
        output = json.loads(response_data)['choices'][0]['message']['content']
    except urllib2.HTTPError as e:
        output = "An HTTP error occurred: {} - {}".format(e.code, e.reason)
    except urllib2.URLError as e:
        output = "A URL error occurred: {}".format(e.reason)
else:
    output = "Sending is disabled."

print(output)
# ---------- end python ----------
panel_7 = Panel(python.out)
python_2 = GhPythonScript(input_text=panel_7, split_after_keyword="Mood:")  # -> extracted
# ---------- python_2: Python ----------
def extract_information(text, keyword):
    split_index = text.find(keyword)
    if split_index != -1:
        start_index = split_index + len(keyword)
        # 找到关键字后的起始位置
        post_keyword_text = text[start_index:].strip()

        # 检查是否是数字
        if post_keyword_text and post_keyword_text[0].isdigit():
            return post_keyword_text.split()[0]  # 只取第一个数字
        else:
            # 寻找第一个换行符，用于文本提取
            newline_index = post_keyword_text.find('\n')
            if newline_index != -1:
                return post_keyword_text[:newline_index].strip()
            else:
                return post_keyword_text.strip()
    return None

result = extract_information(input_text, split_after_keyword)
print(result)
# ---------- end python_2 ----------
python_3 = GhPythonScript(input_text=panel_7, split_after_keyword="Score:")  # -> extracted; same code as python_2
python_4 = GhPythonScript(input_text=panel_7, split_after_keyword="Reason:")  # -> extracted; same code as python_2
panel_8 = Panel(python_2)
panel_9 = Panel(python_3)
panel_10 = Panel(python_4)
