# Grasshopper definition LinkAI_GH_Henrik_RH7_3_modes_Final.gh (Grasshopper 1.0.7)
# plug-ins: ShapeDiverForGrasshopper

# No image input
sddp = ShapeDiverDocumentPayload({AbsoluteTolerance=0, AngleTolerance=0, DistanceDisplayPrecision=0, GltfVersion="Gltf2", GrasshopperVersion="1.0.0007", InputGroups="{}", OutputGroups="{}", RelativeTolerance=0, RhinoVersion="7.34.23267.11001", UnitSystem=0, VersionCreated="1.20.0.0", VersionSaved="1.20.0.0"})
# With image input
# For available models, please check LinkAI API website:
# 
# https://docs.link-ai.tech/platform/api/chat
panel = Panel("https://i.ibb.co/7RV2q7b/icon.png")
# Register for your own API at:
# 
# https://link-ai.tech/home?share=Hr95VL
panel_2 = Panel("Describe this image")

# ---- group: Inputs
panel_3 = Panel("You are a sentiment analysis expert, after the user inputs a sentence, please output mood and a score from 1-10, where 10 is positive, 1 is negative. Provide output as the following format: Mood: Score: Reason: ")
panel_4 = Panel("This lesson is boring")

# With own bot
panel_5 = Panel("When is the deadline for CW1 of ARC411?")

# ---- group: Settings
# For available models, please check LinkAI API website:
# 
# https://docs.link-ai.tech/platform/api/chat
number_slider = Slider(0, range=0..1)
panel_6 = Panel("wenxin")
panel_7 = Panel("gemini-1.5-flash")
panel_8 = Panel("claude-3-haiku")
panel_9 = Panel("LinkAI-4o-mini")
panel_10 = Panel("qwen-turbo")

# ---- group: API Key
# Register for your own API at:
# 
# https://link-ai.tech/home?share=Hr95VL
panel_11 = Panel("Link_5BtepTCZke2H1qxuPACOgwf32rIR0v13P3YfJKVBWn")

# Register for your own API at:
# 
# https://link-ai.tech/home?share=Hr95VL
panel_12 = Panel("Link_5BtepTCZke2H1qxuPACOgwf32rIR0v13P3YfJKVBWn")

# ----
llm_processing_henrik = GhPythonScript(API_KEY=panel_11, System_Message=panel_3, Prompt=panel_4, AI_Model=panel_9, Randomness=number_slider, SEND=Toggle(False))  # -> out, a; inputs SEND: Boolean
# ---------- llm_processing_henrik: Python ----------
import urllib2
import json

model = AI_Model
temperature = Randomness


# 创建请求
url = 'https://api.link-ai.tech/v1/chat/completions'
headers = {
    'Content-Type': 'application/json',
    'Authorization': 'Bearer {}'.format(API_KEY)
}
payload = {
    "temperature": temperature,
    "model": model,
    "messages": [
        {
            "role": "system",
            "content": [
                {"type": "text", "text": System_Message}
            ]
        },
        {
            "role": "user",
            "content": [
                {"type": "text", "text": Prompt}
            ]
        }
    ],
    "max_tokens": 300
}

data = json.dumps(payload)

if SEND:
    try:
        req = urllib2.Request(url, data, headers)
        response = urllib2.urlopen(req)
        response_data = response.read()
        output = json.loads(response_data)['choices'][0]['message']['content']
    except urllib2.HTTPError as e:
        output = "An HTTP error occurred: {} - {}".format(e.code, e.reason)
    except urllib2.URLError as e:
        output = "A URL error occurred: {}".format(e.reason)
else:
    output = "Sending is disabled."

print(output)
# ---------- end llm_processing_henrik ----------
llm_processing_henrik_2 = GhPythonScript(
    API_KEY="Link_5BtepTCZke2H1qxuPACOgwf32rIR0v13P3YfJKVBWn",
    App_code="4iVChQpc",
    Prompt=panel_2,
    image_URL=panel,
    SEND=Toggle(False))  # -> out, a; inputs SEND: Boolean
# ---------- llm_processing_henrik_2: Python ----------
import urllib2
import json

url = 'https://api.link-ai.tech/v1/chat/completions'
headers = {
    'Content-Type': 'application/json',
    'Authorization': 'Bearer {}'.format(API_KEY)
}
payload = {
    "app_code": App_code,
    "messages": [
      {
        "role": "user",
        "content": [
          {
            "type": "text",
            "text": Prompt
          },
          {
            "type": "image_url",
            "image_url": {
              "url": image_URL
            }
          }
        ]
      }
    ]
  }

data = json.dumps(payload)

if SEND:
    try:
        req = urllib2.Request(url, data, headers)
        response = urllib2.urlopen(req)
        response_data = response.read()
        output = json.loads(response_data)['choices'][0]['message']['content']
    except urllib2.HTTPError as e:
        output = "An HTTP error occurred: {} - {}".format(e.code, e.reason)
    except urllib2.URLError as e:
        output = "A URL error occurred: {}".format(e.reason)
else:
    output = "Sending is disabled."

print(output)
# ---------- end llm_processing_henrik_2 ----------
llm_processing_henrik_3 = GhPythonScript(API_KEY=panel_12, App_code="4iVChQpc", Prompt=panel_5, SEND=Toggle(False))  # -> out, a; inputs SEND: Boolean
# ---------- llm_processing_henrik_3: Python ----------
import urllib2
import json


# 创建请求
url = 'https://api.link-ai.tech/v1/chat/completions'
headers = {
    'Content-Type': 'application/json',
    'Authorization': 'Bearer {}'.format(API_KEY)
}
payload = {
    "app_code": App_code,
    "messages": [
        {
            "role": "user",
            "content": [
                {"type": "text", "text": Prompt}
            ]
        }
    ],
    "max_tokens": 300
}

data = json.dumps(payload)

if SEND:
    try:
        req = urllib2.Request(url, data, headers)
        response = urllib2.urlopen(req)
        response_data = response.read()
        output = json.loads(response_data)['choices'][0]['message']['content']
    except urllib2.HTTPError as e:
        output = "An HTTP error occurred: {} - {}".format(e.code, e.reason)
    except urllib2.URLError as e:
        output = "A URL error occurred: {}".format(e.reason)
else:
    output = "Sending is disabled."

print(output)
# ---------- end llm_processing_henrik_3 ----------
outputs = Panel(llm_processing_henrik_2.out)
outputs_2 = Panel(llm_processing_henrik_3.out)
outputs_3 = Panel(llm_processing_henrik.out)

# ---- group: Extraction
python = GhPythonScript(split_after_keyword="Mood:")  # -> extracted
# ---------- python: Python ----------
def extract_information(text, keyword):
    if not text:
        return "There is no input_text."
    
    split_index = text.find(keyword)
    if split_index != -1:
        start_index = split_index + len(keyword)
        post_keyword_text = text[start_index:].strip()

        if post_keyword_text and post_keyword_text[0].isdigit():
            return post_keyword_text.split()[0]  # 只取第一个数字
        else:
            newline_index = post_keyword_text.find('\n')
            if newline_index != -1:
                return post_keyword_text[:newline_index].strip()
            else:
                return post_keyword_text.strip()
    return None

result = extract_information(input_text, split_after_keyword)
print(result)
# ---------- end python ----------

python_2 = GhPythonScript(split_after_keyword="Score:")  # -> extracted; same code as python

python_3 = GhPythonScript(input_text=outputs_3, split_after_keyword="Mood:")  # -> extracted; same code as python

python_4 = GhPythonScript(input_text=outputs_3, split_after_keyword="Score:")  # -> extracted; same code as python

# ----
python_5 = GhPythonScript(split_after_keyword="Mood:")  # -> extracted; same code as python
python_6 = GhPythonScript(split_after_keyword="Score:")  # -> extracted; same code as python
rec = Rectangle({Plane=PlaneXY(14.51110044, 0.5038006612, 0), Size=Domain2(u=-4.335545537..4.335545537, v=-3.775089152..3.775089152)})
Z = UnitZ(Factor=python_4)
panel_13 = Panel(python_5)
panel_14 = Panel(python_6)
panel_15 = Panel(python)
panel_16 = Panel(python_2)
panel_17 = Panel(python_3)
extr = Extrude(Base=rec, Direction=Z)
panel_18 = Panel(python_4)
