# Grasshopper definition LinkAI_GH_Henrik_RH7_VQA.gh (Grasshopper 1.0.7)
# plug-ins: ShapeDiverForGrasshopper

# No image input
sddp = ShapeDiverDocumentPayload({AbsoluteTolerance=0, AngleTolerance=0, DistanceDisplayPrecision=0, GltfVersion="Gltf2", GrasshopperVersion="1.0.0007", InputGroups="{}", OutputGroups="{}", RelativeTolerance=0, RhinoVersion="7.34.23267.11001", UnitSystem=0, VersionCreated="1.20.0.0", VersionSaved="1.20.0.0"})

# ---- group: Inputs
panel = Panel("You are a sentiment analysis expert, after the user inputs a sentence, please output mood and a score from 1-10, where 10 is positive, 1 is negative. Provide output as the following format: Mood: Score: Reason: ")
panel_2 = Panel("Today is a very sunny hump day")

# ----
# With image input
# For available models, please check LinkAI API website:
# 
# https://docs.link-ai.tech/platform/api/chat
panel_3 = Panel("https://i.ibb.co/7RV2q7b/icon.png")
# Register for your own API at:
# 
# https://link-ai.tech/home?share=Hr95VL
panel_4 = Panel("Describe this image")

# ---- group: Settings
# For available models, please check LinkAI API website:
# 
# https://docs.link-ai.tech/platform/api/chat
number_slider = Slider(0, range=0..1)
panel_5 = Panel("wenxin")
panel_6 = Panel("gemini-1.5-flash")
panel_7 = Panel("claude-3-haiku")
panel_8 = Panel("LinkAI-4o-mini")
panel_9 = Panel("qwen-turbo")

# ---- group: API Key
# Register for your own API at:
# 
# https://link-ai.tech/home?share=Hr95VL
panel_10 = Panel("Link_5BtepTCZke2H1qxuPACOgwf32rIR0v13P3YfJKVBWn-R0J7gU9r")

# ----
llm_processing_henrik = GhPythonScript(API_KEY=panel_10, System_Message=panel, Prompt=panel_2, AI_Model=panel_8, Randomness=number_slider, SEND=Toggle(False))  # -> out, a; inputs SEND: Boolean
# ---------- llm_processing_henrik: Python ----------
import urllib2
import json

model = AI_Model
temperature = Randomness


# 创建请求
url = 'https://api.link-ai.tech/v1/chat/completions'
headers = {
    'Content-Type': 'application/json',
    'Authorization': 'Bearer {}'.format(API_KEY)
}
payload = {
    "temperature": temperature,
    "model": model,
    "messages": [
        {
            "role": "system",
            "content": [
                {"type": "text", "text": System_Message}
            ]
        },
        {
            "role": "user",
            "content": [
                {"type": "text", "text": Prompt}
            ]
        }
    ],
    "max_tokens": 300
}

data = json.dumps(payload)

if SEND:
    try:
        req = urllib2.Request(url, data, headers)
        response = urllib2.urlopen(req)
        response_data = response.read()
        output = json.loads(response_data)['choices'][0]['message']['content']
    except urllib2.HTTPError as e:
        output = "An HTTP error occurred: {} - {}".format(e.code, e.reason)
    except urllib2.URLError as e:
        output = "A URL error occurred: {}".format(e.reason)
else:
    output = "Sending is disabled."

print(output)
# ---------- end llm_processing_henrik ----------
llm_processing_henrik_2 = GhPythonScript(
    API_KEY="Link_5BtepTCZke2H1qxuPACOgwf32rIR0v13P3YfJKVBWn",
    App_code="R0J7gU9r",
    Prompt=panel_4,
    image_URL=panel_3,
    SEND=Toggle(False))  # -> out, a; inputs SEND: Boolean
# ---------- llm_processing_henrik_2: Python ----------
import urllib2
import json

url = 'https://api.link-ai.tech/v1/chat/completions'
headers = {
    'Content-Type': 'application/json',
    'Authorization': 'Bearer {}'.format(API_KEY)
}
payload = {
    "app_code": App_code,
    "messages": [
      {
        "role": "user",
        "content": [
          {
            "type": "text",
            "text": Prompt
          },
          {
            "type": "image_url",
            "image_url": {
              "url": image_URL
            }
          }
        ]
      }
    ]
  }

data = json.dumps(payload)

if SEND:
    try:
        req = urllib2.Request(url, data, headers)
        response = urllib2.urlopen(req)
        response_data = response.read()
        output = json.loads(response_data)['choices'][0]['message']['content']
    except urllib2.HTTPError as e:
        output = "An HTTP error occurred: {} - {}".format(e.code, e.reason)
    except urllib2.URLError as e:
        output = "A URL error occurred: {}".format(e.reason)
else:
    output = "Sending is disabled."

print(output)
# ---------- end llm_processing_henrik_2 ----------
outputs = Panel(llm_processing_henrik_2.out)
outputs_2 = Panel(llm_processing_henrik.out)

# ---- group: Extraction
python = GhPythonScript(input_text=outputs_2, split_after_keyword="Mood:")  # -> extracted
# ---------- python: Python ----------
def extract_information(text, keyword):
    if not text:
        return "There is no input_text."
    
    split_index = text.find(keyword)
    if split_index != -1:
        start_index = split_index + len(keyword)
        post_keyword_text = text[start_index:].strip()

        if post_keyword_text and post_keyword_text[0].isdigit():
            return post_keyword_text.split()[0]  # 只取第一个数字
        else:
            newline_index = post_keyword_text.find('\n')
            if newline_index != -1:
                return post_keyword_text[:newline_index].strip()
            else:
                return post_keyword_text.strip()
    return None

result = extract_information(input_text, split_after_keyword)
print(result)
# ---------- end python ----------

python_2 = GhPythonScript(input_text=outputs_2, split_after_keyword="Score:")  # -> extracted; same code as python

# ----
python_3 = GhPythonScript(input_text=outputs, split_after_keyword="Mood:")  # -> extracted; same code as python
python_4 = GhPythonScript(input_text=outputs, split_after_keyword="Score:")  # -> extracted; same code as python
panel_11 = Panel(python)
panel_12 = Panel(python_2)
panel_13 = Panel(python_3)
panel_14 = Panel(python_4)
