# Grasshopper definition LinkAI_GH_Henrik_RH8.gh (Grasshopper 1.0.8)
# plug-ins: RhinoCodePluginGH

# ---- group: Inputs
panel = Panel("You are a sentiment analysis expert, after the user inputs a sentence, please output mood and a score from 1-10, where 10 is positive, 1 is negative. Provide output as the following format: Mood: Score: Reason: ")
panel_2 = Panel("Today is a very sunny hump day")

# ----
# For available models, please check LinkAI API website:
# 
# https://docs.link-ai.tech/platform/api/chat
number_slider = Slider(0.1, range=0..1)
panel_3 = Panel("wenxin")
panel_4 = Panel("gemini-1.5-flash")
panel_5 = Panel("claude-3-haiku")
panel_6 = Panel("qwen-turbo")

# ----
# Register for your own API at:
# 
# https://link-ai.tech/home?share=Hr95VL
panel_7 = Panel("Link_5BtepTCZke2H1qxuPACOgwf32rIR0v13P3YfJKVBWn")

# ---- group: LinkAI_Connection
llm_processing_henrik = Python3Script(
    API_KEY=panel_7,
    System_Message=panel,
    Prompt=panel_2,
    AI_Model="LinkAI-4o-mini",
    Randomness=number_slider,
    SEND=Toggle(False))  # -> output; inputs API_KEY: String, System_Message: String, Prompt: String, SEND: Boolean
# ---------- llm_processing_henrik: Python ----------
import requests

headers = {
    "Content-Type": "application/json",
    "Authorization": f"Bearer {API_KEY}"
}

model = AI_Model
temperature = Randomness

if SEND:
    payload = {
        "temperature": temperature,
        "model": model,
        #"app_code": "xxxxxxxx",
        "messages": [
        {
            "role": "system",
            "content": [
            {"type": "text", "text": System_Message}
            ]
        },
        {
            "role": "user",
            "content": [
            {"type": "text", "text": Prompt}
            ]
        }],
        "max_tokens": 300
    }
    response = requests.post("https://api.link-ai.tech/v1/chat/completions", headers=headers, json=payload)



    output = response.json()['choices'][0]['message']['content']
else:
    output = "Sending is disabled."
# ---------- end llm_processing_henrik ----------

# ----
outputs = Panel(llm_processing_henrik)
extract_data_after_keyword = Python3Script(input_text=outputs, split_after_keyword="Score:")  # -> extracted; inputs input_text: String, split_after_keyword: String
# ---------- extract_data_after_keyword: Python ----------
import re

text = input_text

keyword = split_after_keyword

match = re.search(re.escape(split_after_keyword) + r'\s*(.+)', input_text)

extracted_value = match.group(1).strip() if match else None

extracted = extracted_value
# ---------- end extract_data_after_keyword ----------
extract_data_after_keyword_2 = Python3Script(input_text=outputs, split_after_keyword="Mood:")  # -> extracted; inputs input_text: String, split_after_keyword: String; same code as extract_data_after_keyword
extract_data_after_keyword_3 = Python3Script(input_text=outputs, split_after_keyword="Reason:")  # -> extracted; inputs input_text: String, split_after_keyword: String; same code as extract_data_after_keyword
panel_8 = Panel(extract_data_after_keyword_3)
panel_9 = Panel(extract_data_after_keyword_2)
panel_10 = Panel(extract_data_after_keyword)
